vi "CLT.gvi"   [LabVIEW Communications System Design Suite 2.0.1]
panel controls:
  "stop": bool
  "milliseconds to wait": u32
  "number of bins": i32 = 10
  "end_it": i32
panel indicators:
  "count": i32
  "histogram": T1
  "size(s)": i32[]
types:
  T1 = cluster{"x values": f64[], "histogram h(x)": f64[]}
uses:
  NI::Analysis::Statistics::Histogram (single-shot)(DBL Array).gvi
diagram:
  s1 = f64[] []  # shift register
  while (iteration -> i1) {
    Is Equal(x=$end_it, y=i1) -> w1
    Logical Or($stop, w1) -> w2
    $count <- i1
    Wait(time to wait=$"milliseconds to wait")
    for (N = 10) {
      for (N = 10) {
        Random Number() -> (number (0 to 1)=w5)
        Subtract(x=w5, y=0.5) -> w6
        Square Root(x=12) -> w7
        Multiply(w6, w7) -> w8
        append w8 to w4
      }
      append w4 to w3
    }
    Array Size(array=w3) -> (size(s)=w9)
    Add Array Elements(numeric array=w3) -> (sum=w10)
    Divide(x=w10, y=w9) -> w11
    Insert Into Array(inArray=s1, index0=i1, new=w11) -> w12
    call "Histogram (single-shot)(DBL Array).gvi"(signal=w12, number of bins=$"number of bins") -> (histogram=w13)
    $histogram <- w13
    $"size(s)" <- w9
    next s1 = w12
    stop if w2
  }
