vi "DataTypes.gvi"   [LabVIEW Communications System Design Suite 2.0.1]
panel controls:
  "Input String": string
panel indicators:
  "Name in bytes": u8[]
  "Converted output": f64[]
  "Avg. Temp (C)": f64
  "Hot?": bool
  "first 3 chars": u8[]
diagram:
  String To Byte Array(string=$"Input String") -> (unsigned byte array=w1)
  Array Subset(array=w1, index0=0, length0=3) -> w2
  $"first 3 chars" <- w2
  $"Name in bytes" <- w1
  Subtract(x=w1, y=32) -> w3
  Divide(x=w3, y=1.8) -> w4
  $"Converted output" <- w4
  Array Size(array=w4) -> (size(s)=w5)
  Add Array Elements(numeric array=w4) -> (sum=w6)
  Divide(x=w6, y=w5) -> w7
  $"Avg. Temp (C)" <- w7
  Is Greater Or Equal(x=w7, y=50) -> w8
  $"Hot?" <- w8
