vi "AM.gvi"   [LabVIEW Communications System Design Suite 2.0.1]
inputs:
  "Message frequency": f64 = 10
  "Message Amplitude": f64 = 1
  "Carrier frequency": f64 = 10
  "Carrier Amplitude": f64 = 1
  "c sample rate": f64 = 1000
  "c samples": i32 = 1000
  "m sample rate": f64 = 1000
  "m samples": i32 = 1000
outputs:
  "message signal": waveform<f64>
  "carrier signal": waveform<f64>
  "AM signal": waveform<f64>
  "PSD of Message": T1
  "PSD of AM": T1
types:
  T1 = cluster{"f0": f64, "df": f64, "magnitude": f64[]}
uses:
  NI::Analysis::Generation::Sine Waveform.gvi
  NI::Analysis::Measurement::Power Spectral Density for 1 Chan.gvi
diagram:
  call "Sine Waveform.gvi"(amplitude=$"Message Amplitude", frequency=$"Message frequency", phase in=90, sample rate=$"m sample rate", samples=$"m samples") -> (sine wave=w1)
  $"message signal" <- w1
  call "Sine Waveform.gvi"(frequency=$"Carrier frequency", phase in=90, sample rate=$"c sample rate", samples=$"c samples") -> (sine wave=w2)
  Waveform Add(w1, $"Carrier Amplitude") -> w3
  Waveform Multiply(w3, w2) -> w4
  $"AM signal" <- w4
  call "Power Spectral Density for 1 Chan.gvi"(signal=w4) -> (power spectral density=w5)
  $"PSD of AM" <- w5
  call "Power Spectral Density for 1 Chan.gvi"(signal=w1) -> (power spectral density=w6)
  $"PSD of Message" <- w6
  Waveform Multiply($"Carrier Amplitude", w2) -> w7
  $"carrier signal" <- w7
