vi "AMCoherent.gvi"   [LabVIEW Communications System Design Suite 2.0.1]
inputs:
  "AM Signal": waveform<f64> = {dt=1, Y=[]}
  "Carrier Signal": waveform<f64> = {dt=1, Y=[]}
  "cutoff frequency": f64 = 0.125
  "order": i32 = 2
  "error in": error
outputs:
  "Demodulated Output": waveform<f64>
  "Demodulated PSD": T1
  "error out": error
panel indicators:
  "Unfiltered": waveform<f64>
  "Unfiltered PSD": T1
types:
  T1 = cluster{"f0": f64, "df": f64, "magnitude": f64[]}
uses:
  NI::Analysis::Measurement::Power Spectral Density for 1 Chan.gvi
  NI::Analysis::Filtering::Butterworth Lowpass Filter (Waveform).gvi
  NI::Analysis::Measurement::AC DC and RMS (single-shot)(Wfm).gvi
diagram:
  Waveform Multiply($"AM Signal", $"Carrier Signal", error in=$"error in") -> (error out=w1, o=w2)
  Waveform Multiply(2, w2, error in=$"error in") -> (error out=w3, o=w4)
  $Unfiltered <- w4
  call "Power Spectral Density for 1 Chan.gvi"(signal=w4) -> (power spectral density=w5)
  $"Unfiltered PSD" <- w5
  call "Butterworth Lowpass Filter (Waveform).gvi"(signal=w4, cutoff frequency=$"cutoff frequency", error in=$"error in", order=$order) -> (filtered signal=w6, error out=w7)
  call "AC DC and RMS (single-shot)(Wfm).gvi"(signal=w6, error in=$"error in") -> (error out=w8, DC value=w9)
  Waveform Subtract(error in=$"error in", x=w6, y=w9) -> (error out=w10, x-y=w11)
  call "Power Spectral Density for 1 Chan.gvi"(signal=w11) -> (power spectral density=w12)
  $"Demodulated PSD" <- w12
  $"Demodulated Output" <- w11
  Merge Errors(w3, w1) -> (error out=w13)
  Merge Errors(w8, w7) -> (error out=w14)
  Merge Errors(w14, w13) -> (error out=w15)
  Merge Errors(w15, w10) -> (error out=w16)
  $"error out" <- w16
