vi "AMEnvelopeDetection.gvi"   [LabVIEW Communications System Design Suite 2.0.1]
inputs:
  "AM Signal": waveform<f64> = {dt=1, Y=[]}
  "cutoff frequency": f64 = 0.125
  "order": i32 = 2
  "error in": error
outputs:
  "Demodulated Output": waveform<f64>
  "error out": error
  "Demodulated signal PSD": T1
types:
  T1 = cluster{"f0": f64, "df": f64, "magnitude": f64[]}
uses:
  NI::Analysis::Filtering::Butterworth Lowpass Filter (Waveform).gvi
  NI::Analysis::Measurement::AC DC and RMS (single-shot)(Wfm).gvi
  NI::Analysis::Measurement::Power Spectral Density for 1 Chan.gvi
diagram:
  Waveform Multiply($"AM Signal", Pi, error in=$"error in") -> (error out=w1, o=w2)
  Property Node(instance in=w2) -> ("Y"=w3, "t0"=w4, "dt"=w5, "attributes"=w6)
  for {
    w7 = each element of w3
    Is Less Than 0(x=w7) -> w9
    Select(s=w9, t=0, f=w7) -> w10
    append w10 to w8
  }
  Build Waveform Node(Y=w8, attributes=w6, dt=w5, t0=w4) -> (output waveform=w11)
  call "Butterworth Lowpass Filter (Waveform).gvi"(signal=w11, cutoff frequency=$"cutoff frequency", error in=$"error in", order=$order) -> (filtered signal=w12, error out=w13)
  call "AC DC and RMS (single-shot)(Wfm).gvi"(signal=w12, error in=$"error in") -> (error out=w14, DC value=w15)
  Waveform Subtract(error in=$"error in", x=w12, y=w15) -> (error out=w16, x-y=w17)
  $"Demodulated Output" <- w17
  call "Power Spectral Density for 1 Chan.gvi"(signal=w17) -> (power spectral density=w18)
  $"Demodulated signal PSD" <- w18
  Merge Errors(w13, w1) -> (error out=w19)
  Merge Errors(w14, w19) -> (error out=w20)
  Merge Errors(w16, w20) -> (error out=w21)
  $"error out" <- w21
