vi "AMTopLevel.gvi"   [LabVIEW Communications System Design Suite 2.0.1]
panel controls:
  "message frequency": f64 = 0.125
  "Message Amplitude": f64 = 1
  "Carrier frequency": f64 = 10
  "Carrier Amplitude": f64 = 1
  "m sample rate": f64 = 1000
  "m samples": i32 = 1000
  "c sample rate": f64 = 1000
  "c samples": i32 = 1000
  "order": i32 = 2
  "stop": bool
  "cutoff frequency": f64 = 0.125
panel indicators:
  "Message Waveform": waveform<f64>
  "AM PSD": T1
  "Message PSD": T1
  "AM Waveform": waveform<f64>
  "Coherent Signal": waveform<f64>
  "Coherent PSD": T1
  "Envelope Signal": waveform<f64>
  "Envelope PSD": T1
types:
  T1 = cluster{"f0": f64, "df": f64, "magnitude": f64[]}
diagram:
  while {
    call "AM.gvi"(Message frequency=$"message frequency", Message Amplitude=$"Message Amplitude", Carrier frequency=$"Carrier frequency", Carrier Amplitude=$"Carrier Amplitude", c sample rate=$"c sample rate", c samples=$"c samples", m sample rate=$"m sample rate", m samples=$"m samples") -> (message signal=w1, carrier signal=w2, AM signal=w3, PSD of Message=w4, PSD of AM=w5)
    $"Message Waveform" <- w1
    $"AM Waveform" <- w2
    call "AMCoherent.gvi"(AM Signal=w3, Carrier Signal=w2, cutoff frequency=$"cutoff frequency", order=$order) -> (Demodulated Output=w6, Demodulated PSD=w7)
    $"Coherent Signal" <- w6
    $"Coherent PSD" <- w7
    call "AMEnvelopeDetection.gvi"(AM Signal=w3, cutoff frequency=$"cutoff frequency", order=$order) -> (Demodulated Output=w8, Demodulated signal PSD=w9)
    $"Envelope Signal" <- w8
    $"Envelope PSD" <- w9
    $"Message PSD" <- w4
    $"AM PSD" <- w5
    stop if $stop
  }
