vi "FMDemodulator.gvi"   [LabVIEW Communications System Design Suite 2.0.1]
inputs:
  "FM in": waveform<f64> = {dt=1, Y=[]}
  "order": i32 = 2
  "cutoff frequency": f64 = 0.125
  "error in": error
outputs:
  "Demodulated Output": waveform<f64>
  "Demodulated signal PSD": T1
  "error out": error
types:
  T1 = cluster{"f0": f64, "df": f64, "magnitude": f64[]}
uses:
  NI::Analysis::IntegralDifferentiation::Derivative x(t).gvi
diagram:
  Property Node(instance in=$"FM in") -> ("Y"=w1, "t0"=w2, "dt"=w3, "attributes"=w4)
  call "Derivative x(t).gvi"(x(t)=w1, dt=w3, error in=$"error in") -> (error out=w5, dx(t)/dt=w6)
  Build Waveform Node(Y=w6, attributes=w4, dt=w3, t0=w2) -> (output waveform=w7)
  call "AMEnvelopeDetection.gvi"(AM Signal=w7, cutoff frequency=$"cutoff frequency", order=$order, error in=w5) -> (Demodulated Output=w8, error out=w9, Demodulated signal PSD=w10)
  $"Demodulated Output" <- w8
  $"Demodulated signal PSD" <- w10
  $"error out" <- w9
