vi "FMModulator.gvi"   [LabVIEW Communications System Design Suite 2.0.1]
inputs:
  "message amplitude": f64 = 1
  "message frequency": f64 = 10
  "message phase in": f64
  "message sample rate": f64 = 1000
  "message samples": i32 = 1000
  "carrier amplitude": f64 = 1
  "carrier frequency": f64 = 10
  "carrier sample rate": f64 = 1000
  "carrier samples": i32 = 1000
  "\\delta f": f64
  "Error in": error
outputs:
  "message signal": waveform<f64>
  "message PSD": T1
  "FM out": waveform<f64>
  "FM PSD": T1
  "error out": error
types:
  T1 = cluster{"f0": f64, "df": f64, "magnitude": f64[]}
uses:
  NI::Analysis::Generation::Sine Waveform.gvi
  NI::Analysis::IntegralDifferentiation::Integral x(t).gvi
  NI::Analysis::Measurement::Power Spectral Density for 1 Chan.gvi
diagram:
  call "Sine Waveform.gvi"(amplitude=$"message amplitude", frequency=$"message frequency", phase in=$"message phase in", error in=$"Error in", sample rate=$"message sample rate", samples=$"message samples") -> (sine wave=w1, error out=w2)
  Property Node(instance in=w1) -> ("Y"=w3, "dt"=w4, "attributes"=w5)
  call "Integral x(t).gvi"(x(t)=w3, dt=w4, error in=w2) -> (error out=w6, integral x(t)=w7)
  # -Sine
  call "Sine Waveform.gvi"(amplitude=$"carrier amplitude", frequency=$"carrier frequency", phase in=180, error in=w6, sample rate=$"carrier sample rate", samples=$"carrier samples") -> (sine wave=w8, error out=w9)
  Multiply(w7, PiTimes2) -> w10
  Multiply(w10, $"\\delta f") -> w11
  Sine And Cosine(x=w11) -> (cos(x)=w12, sin(x)=w13)
  Build Waveform Node(Y=w13, attributes=w5, dt=w4) -> (output waveform=w14)
  Waveform Multiply(w14, w8, error in=w9) -> (error out=w15, o=w16)
  # Cosine
  call "Sine Waveform.gvi"(amplitude=$"carrier amplitude", frequency=$"carrier frequency", phase in=90, error in=w6, sample rate=$"carrier sample rate", samples=$"carrier samples") -> (sine wave=w17, error out=w18)
  Build Waveform Node(Y=w12, attributes=w5, dt=w4) -> (output waveform=w19)
  Waveform Multiply(w19, w17, error in=w18) -> (error out=w20, o=w21)
  Merge Errors(w15, w20) -> (error out=w22)
  Waveform Add(w16, w21, error in=w22) -> (error out=w23, o=w24)
  $"FM out" <- w24
  call "Power Spectral Density for 1 Chan.gvi"(signal=w24) -> (power spectral density=w25)
  $"FM PSD" <- w25
  call "Power Spectral Density for 1 Chan.gvi"(signal=w1) -> (power spectral density=w26)
  $"message PSD" <- w26
  $"error out" <- w23
  $"message signal" <- w1
