vi "FMTopLevel.gvi"   [LabVIEW Communications System Design Suite 2.0.1]
panel controls:
  "\\delta f": f64
  "message amplitude": f64 = 1
  "message frequency": f64 = 10
  "message phase in": f64
  "message sample rate": f64 = 1000
  "message samples": i32 = 1000
  "Error in": error
  "carrier amplitude": f64 = 1
  "carrier frequency": f64 = 10
  "carrier sample rate": f64 = 1000
  "carrier samples": i32 = 1000
  "order": i32 = 2
  "cutoff frequency": f64 = 0.125
panel indicators:
  "error out": error
  "FM out": waveform<f64>
  "message PSD": T1
  "FM PSD": T1
  "Demodulated Output": waveform<f64>
  "message signal": waveform<f64>
  "Demodulated PSD": T1
types:
  T1 = cluster{"f0": f64, "df": f64, "magnitude": f64[]}
diagram:
  call "FMModulator.gvi"(message amplitude=$"message amplitude", message frequency=$"message frequency", message phase in=$"message phase in", message sample rate=$"message sample rate", message samples=$"message samples", carrier amplitude=$"carrier amplitude", carrier frequency=$"carrier frequency", carrier sample rate=$"carrier sample rate", carrier samples=$"carrier samples", \delta f=$"\\delta f", Error in=$"Error in") -> (message signal=w1, message PSD=w2, FM out=w3, FM PSD=w4, error out=w5)
  $"message signal" <- w1
  $"message PSD" <- w2
  $"FM PSD" <- w4
  call "FMDemodulator.gvi"(FM in=w3, order=$order, cutoff frequency=$"cutoff frequency", error in=w5) -> (Demodulated Output=w6, Demodulated signal PSD=w7, error out=w8)
  $"Demodulated Output" <- w6
  $"Demodulated PSD" <- w7
  $"FM out" <- w3
  $"error out" <- w8
