vi "DPSK.gvi"   [LabVIEW Communications System Design Suite 2.0.1]
panel controls:
  "IQ rate": f64 = 200000
  "device names": "niUSRPClass"
  "carrier frequency": f64 = 400000000
  "gain Tx": f64
  "active antenna Tx": string = "TX1"
  "stop Tx": bool
  "gain Rx": f64
  "active antenna Rx": string = "RX2"
  "total bits": i32 = 128
  "symbol rate": f64
  "pulse shaping filter": T2 = "Root Raised Cos"
panel indicators:
  "Baseband Waveform": waveform<f64>
  "Baseband Power Spectrum_tx": T1
  "L": f64
  "1/Tx": f64
  "1/T": f64
  "No samples": i32
  "Baseband Power Spectrum_rx": T1
  "M": f64
  "output bits": i16[]
  "trigger found?": bool
  "BER": f64
  "test": f64[]
  "message": i8[]
types:
  T1 = cluster{"f0": f64, "df": f64, "magnitude": f64[]}
  T2 = enum{"none", "Raised Cosine", "Root Raised Cos", "Gaussian"}
uses:
  NI::Analysis::Conditioning::Shift Array.gvi
  NI::Analysis::Resampling::Upsample (DBL).gvi
  NI::Analysis::Operations::1D Convolution (DBL).gvi
  NI::Analysis::Operations::1D Convolution (CDB).gvi
  NI::Analysis::Resampling::Decimate (single shot, CDB).gvi
diagram:
  call "MT Generate Bits (Fibonacci, PN Order).gvi"(total bits=$"total bits") -> (output bit stream=w1)
  for {
    w2 = each element of w1
    Is Greater Than 0(x=w2) -> w4
    Select(s=w4, t=w2, f=-1) -> w5
    append w5 to w3
  }
  call "AddFrameHeader.gvi"(array=w3) -> (output array=w6)
  call "Shift Array.gvi"(input array=w6, number of shifts=1) -> (shifted array=w7)
  for {
    w8 = each element of w6
    w9 = each element of w7
    Multiply(w8, w9) -> w11
    append w11 to w10
  }
  $test <- w10
  $message <- w1
  Divide(x=$"IQ rate", y=$"symbol rate") -> w12
  call "Upsample (DBL).gvi"(input array=w10, upsampling factor=w12) -> (upsampled array=w13)
  call "MT Generate Filter Coefficients.gvi"(pulse shaping filter=$"pulse shaping filter", pulse shaping samples per symbol=w12, modulation type="PSK") -> (pulse shaping filter coefficients=w14)
  call "1D Convolution (DBL).gvi"(x=w13, y=w14) -> (x * y=w15)
  call "Quick Scale 1D.gvi"(X=w15) -> (Y[i]=X[i]/Max|X|=w16)
  Build Waveform Node(Y=w16, dt=$"IQ rate") -> (output waveform=w17)
  $"Baseband Waveform" <- w17
  w18 = cluster{"t0": timestamp, "dt": f64, "Y": c128[]} {all zero or empty}
  Property Node(instance in=w18, "dt"=$"IQ rate", "Y"=w16) -> (instance out=w19)
  call "FFT Power Spectrum for 1 Chan (CDB)2.gvi"(time signal=w19, dB On (F)=TRUE) -> (power spectrum=w20)
  $"Baseband Power Spectrum_tx" <- w20
  $L <- w12
  $"1/Tx" <- $"IQ rate"
  $"1/T" <- $"symbol rate"
  Array Size(array=w16) -> (size(s)=w21)
  Multiply(w21, 2) -> w22
  call "niUSRP Open Rx Session.gvi"(device names=$"device names") -> (error out=w23, session handle out=w24)
  call "niUSRP Configure Signal.gvi"(session handle=w24, IQ rate=$"IQ rate", carrier frequency=$"carrier frequency", gain=$"gain Rx", error in=w23, active antenna=$"active antenna Rx") -> (session handle out=w25, coerced carrier frequency=w26, error out=w27)
  Subtract(x=w26, y=19999) -> w28
  Property Node(instance in=w25, "LO Frequency"=w28) -> (instance out=w29)
  call "niUSRP Initiate.gvi"(session handle=w29, error in=w27) -> (session handle out=w30, error out=w31)
  call "niUSRP Fetch Rx Data (CDB).gvi"(session handle=w30, number of samples=w22, error in=w31) -> (session handle out=w32, data=w33, error out=w34)
  call "niUSRP Close Session.gvi"(session handle=w32, error in=w34)
  $"No samples" <- w21
  call "niUSRP Open Tx Session.gvi"(device names=$"device names") -> (session handle out=w35, error out=w36)
  call "niUSRP Configure Signal.gvi"(session handle=w35, IQ rate=$"IQ rate", carrier frequency=$"carrier frequency", gain=$"gain Tx", error in=w36, active antenna=$"active antenna Tx") -> (session handle out=w37, error out=w38)
  while {
    call "niUSRP Write Tx Data (CDB).gvi"(session handle=w37, data=w16, error in=w38) -> (session handle out=w39, error out=w40)
    stop if $"stop Tx"
  }
  call "niUSRP Close Session.gvi"(session handle=w39, error in=w40)
  $M <- w12
  call "MT Generate Filter Coefficients.gvi"(pulse shaping filter="Root Raised Cos", matched samples per symbol=w12, modulation type="PSK") -> (matched filter coefficients=w41)
  call "1D Convolution (CDB).gvi"(x=w41, y=w33) -> (x * y=w42)
  w43 = cluster{"t0": timestamp, "dt": f64, "Y": c128[]} {all zero or empty}
  Property Node(instance in=w43, "dt"=$"IQ rate", "Y"=w42) -> (instance out=w44)
  call "FFT Power Spectrum for 1 Chan (CDB)2.gvi"(time signal=w44, dB On (F)=TRUE) -> (power spectrum=w45)
  $"Baseband Power Spectrum_rx" <- w45
  call "PulseAlign.gvi"(Input signal=w42, Receiver Sampling Factor=w12) -> (aligned output=w46)
  call "Decimate (single shot, CDB).gvi"(input array=w46, decimating factor=w12) -> (decimated array=w47)
  Complex To Real Imaginary(x + iy=w47) -> (x=w48, y=w49)
  call "Shift Array.gvi"(input array=w49, number of shifts=1) -> (shifted array=w50)
  call "Shift Array.gvi"(input array=w48, number of shifts=1) -> (shifted array=w51)
  Real And Imaginary To Complex(x=w51, y=w50) -> w52
  for {
    w53 = each element of w47
    w54 = each element of w52
    Complex Conjugate(x + iy=w54) -> w56
    Multiply(w53, w56) -> w57
    Complex To Real Imaginary(x + iy=w57) -> (x=w58)
    append w58 to w55
  }
  call "FrameSync.gvi"(Sampled Input=w55) -> (Aligned Samples=w59)
  for {
    w60 = each element of w59
    Complex To Real Imaginary(x + iy=w60) -> (x=w62)
    Is Greater Than 0(x=w62) -> w63
    append w63 to w61
  }
  Boolean To Integer(Boolean=w61) -> (0, 1=w64)
  Array Subset(array=w64, index0=0, length0=$"total bits") -> w65
  call "MT Calculate BER After Trigger (Fibonacci PN Sequence).gvi"(input bit stream=w65, BER trigger threshold=0.4) -> (BER=w66, trigger found?=w67)
  $BER <- w66
  $"trigger found?" <- w67
  $"output bits" <- w65
