vi "BER.gvi"   [LabVIEW Communications System Design Suite 2.0.1]
inputs:
  "transmitted bits": i8[]
  "received bits": i8[]
outputs:
  "BER": f64
diagram:
  Array Size(array=$"received bits") -> (size(s)=w1)
  C Code Node("received_bits"=$"received bits", "transmitted_bits"=$"transmitted bits", "length"=w1) -> ("BER"=w2)
  ~~~
  int i;
  double count=0;

  for(i=0; i<length; i++){

      if(received_bits[i]!=transmitted_bits[i]){

          count++;
      }
  }

  BER=count/(double)length;
  ~~~
  $BER <- w2
