vi "BPSK_Tx_Rx_Template.gvi"   [LabVIEW Communications System Design Suite 2.0.1]
panel controls:
  "IQ rate": f64 = 200000
  "device names": "niUSRPClass"
  "carrier frequency": f64 = 400000000
  "gain Tx": f64
  "active antenna Tx": string = "TX1"
  "stop Tx": bool
  "gain Rx": f64
  "active antenna Rx": string = "RX2"
  "total bits": i32 = 128
  "symbol rate": f64
  "pulse shaping filter": T2 = "Root Raised Cos"
panel indicators:
  "Baseband Waveform": waveform<f64>
  "Baseband Power Spectrum": T1
  "L": f64
  "1/Tx": f64
  "1/T": f64
types:
  T1 = cluster{"f0": f64, "df": f64, "magnitude": f64[]}
  T2 = enum{"none", "Raised Cosine", "Root Raised Cos", "Gaussian"}
uses:
  NI::Analysis::Resampling::Upsample (DBL).gvi
  NI::Analysis::Operations::1D Convolution (DBL).gvi
diagram:
  call "MT Generate Bits (Fibonacci, PN Order).gvi"(total bits=$"total bits") -> (output bit stream=w1)
  for {
    w2 = each element of w1
    Is Greater Than 0(x=w2) -> w4
    Select(s=w4, t=w2, f=-1) -> w5
    append w5 to w3
  }
  call "AddFrameHeader.gvi"(array=w3) -> (output array=w6)
  Divide(x=$"IQ rate", y=$"symbol rate") -> w7
  call "Upsample (DBL).gvi"(input array=w6, leading zeros=w7) -> (upsampled array=w8)
  call "MT Generate Filter Coefficients.gvi"(pulse shaping filter=$"pulse shaping filter", pulse shaping samples per symbol=w7, modulation type="PSK") -> (pulse shaping filter coefficients=w9)
  call "1D Convolution (DBL).gvi"(x=w8, y=w9) -> (x * y=w10)
  call "Quick Scale 1D.gvi"(X=w10) -> (Y[i]=X[i]/Max|X|=w11)
  Build Waveform Node(Y=w11, dt=$"IQ rate") -> (output waveform=w12)
  $"Baseband Waveform" <- w12
  w13 = cluster{"t0": timestamp, "dt": f64, "Y": c128[]} {all zero or empty}
  Property Node(instance in=w13, "dt"=$"IQ rate", "Y"=w11) -> (instance out=w14)
  call "FFT Power Spectrum for 1 Chan (CDB)2.gvi"(time signal=w14, dB On (F)=TRUE) -> (power spectrum=w15)
  $"Baseband Power Spectrum" <- w15
  $L <- w7
  $"1/Tx" <- $"IQ rate"
  $"1/T" <- $"symbol rate"
  call "niUSRP Open Rx Session.gvi"(device names=$"device names") -> (error out=w16, session handle out=w17)
  call "niUSRP Configure Signal.gvi"(session handle=w17, IQ rate=$"IQ rate", carrier frequency=$"carrier frequency", gain=$"gain Rx", error in=w16, active antenna=$"active antenna Rx") -> (session handle out=w18, coerced carrier frequency=w19, error out=w20)
  Subtract(x=w19, y=20000) -> w21
  Property Node(instance in=w18, "LO Frequency"=w21) -> (instance out=w22)
  call "niUSRP Initiate.gvi"(session handle=w22, error in=w20) -> (session handle out=w23, error out=w24)
  call "niUSRP Fetch Rx Data (CDB).gvi"(session handle=w23, number of samples=1000000, error in=w24) -> (session handle out=w25, error out=w26)
  call "niUSRP Close Session.gvi"(session handle=w25, error in=w26)
  call "niUSRP Open Tx Session.gvi"(device names=$"device names") -> (session handle out=w27, error out=w28)
  call "niUSRP Configure Signal.gvi"(session handle=w27, IQ rate=$"IQ rate", carrier frequency=$"carrier frequency", gain=$"gain Tx", error in=w28, active antenna=$"active antenna Tx") -> (session handle out=w29, error out=w30)
  Real And Imaginary To Complex(x=w11, y=f64[] []) -> w31
  call "Insert Pilots.gvi"(signal input=w31) -> (output signal=w32)
  call "AddFrameHeader (complex).gvi"(array=w32) -> (output array=w33)
  while {
    call "niUSRP Write Tx Data (CDB).gvi"(session handle=w29, data=w33, error in=w30) -> (session handle out=w34, error out=w35)
    stop if $"stop Tx"
  }
  call "niUSRP Close Session.gvi"(session handle=w34, error in=w35)
